# Dynamo graph script.dyn "CXS_99_Beams" (Dynamo 2.6.2.15705)
# packages: Crumple 2022.5.27, archi-lab.net 2022.212.2722, spring nodes 210.1.1, Clockwork for Dynamo 2.x 2.3.0

select_face_s_where_beam_s = SelectFaces()  # "Select Face(s) where beam(s) should be placed"; 2 picked in the model; graph input
what_does_this_script_do = StringInput("What does this script do?")
what_does_this_script_do_2 = StringInput("""With this script you can place beams on the centre line of a rectangular surfaces.
The script takes the selected surface, finds the two shortest edges and draws a line from the centre of these edges. This line is used to create a beam by a curve. """)
ui_messenger = Custom[© UI.Messenger](title=what_does_this_script_do, body=what_does_this_script_do_2, pass=select_face_s_where_beam_s)  # frozen; package Crumple; Displays a message box with a title/body and OK/cancel button. If OK is selected, the third input's data will be passed through.
passThrough = Custom[PassThrough](passThrough=select_face_s_where_beam_s, waitFor=ui_messenger)  # package archi-lab.net; Ripped this off from Clockwork. Sorry Andy.
family_types = FamilyTypes("Holz Träger - rechteckig:Holz 80 x 120")  # graph input
string = StringInput("Which beam do you want to use?")
boolean = BoolSelector(false)
ꟿ_list_dropdown = Custom[ꟿ List.DropDown](list=family_types, customMsg=string, reset=boolean)  # frozen; package spring nodes; Selects one list item by a drop-down combo box. The optional names input will override the object representation.
perimeterCurves = Surface.PerimeterCurves(surface=select_face_s_where_beam_s)
length = Curve.Length(curve=perimeterCurves)
sortByKey = List.SortByKey(list=perimeterCurves@L2, keys=length@L2, lacing=Shortest)
code_block = CodeBlock { 0; 1; }
getItemAtIndex = List.GetItemAtIndex(list=sortByKey.sorted_list@L2, index=code_block.out0)
code_block_2 = CodeBlock { 0.5; }
pointAtParameter = Curve.PointAtParameter(curve=getItemAtIndex, param=code_block_2)
getItemAtIndex_2 = List.GetItemAtIndex(list=sortByKey.sorted_list@L2, index=code_block.out1)
pointAtParameter_2 = Curve.PointAtParameter(curve=getItemAtIndex_2, param=code_block_2)
byStartPointEndPoint = Line.ByStartPointEndPoint(startPoint=pointAtParameter, endPoint=pointAtParameter_2)
levels = Levels("06_DA_UKRD")  # graph input
beamByCurve = StructuralFraming.BeamByCurve(curve=byStartPointEndPoint, level=levels, structuralFramingType=family_types)  # graph output
passthrough = Custom[Passthrough](passThrough=select_face_s_where_beam_s, waitFor=beamByCurve)  # package Clockwork for Dynamo 2.x; Forces a sequential order of execution. The node wired into the output of the Passthrough node will be executed *after* the node wired into the waitFor input (e.g. important for some Revit operations). The value of the passThrough input will be passed on to the node wired into the output port of the Passthrough node.
fromDynamoSurface = Custom[Element.FromDynamoSurface](DynamoSurface=passthrough)  # package Clockwork for Dynamo 2.x; Returns the underlying Revit element of a given face
delete = Element.Delete(element=fromDynamoSurface)
