# Dynamo graph script.dyn "PlaceViewsOnSheet" (Dynamo 2.6.1.8786)
# packages: Crumple 2022.5.27, Genius Loci 2023.2.21, Clockwork for Dynamo 1.x 1.31.1, MEPover 2022.10.30, Cross-Tools 0.0.1, Data-Shapes 2022.2.105

boolean = BoolSelector(true)
code_block = CodeBlock { "Title Blocks"; }
byName = Category.ByName(name=code_block)
all_family_types_of_category = Custom[All Family Types Of Category](category=byName)  # package Clockwork for Dynamo 1.x; Gets all family types/symbols of a given category in the model (does *not *work for system families)
code_block_2 = CodeBlock { 18; }
getItemAtIndex = List.GetItemAtIndex(list=all_family_types_of_category, index=code_block_2)
string = StringInput("TestSheet8")
string_2 = StringInput("005")
sheets_create = Custom[© Sheets.Create](ttb_type=getItemAtIndex, names=string, numbers=string_2)  # package Crumple; Creates Revit sheets based on a list of names, numbers and a single Titleblock type.
passthrough = Custom[Passthrough](passThrough=sheets_create.sheets, waitFor=sheets_create.success)  # package Clockwork for Dynamo 1.x; Forces a sequential order of execution. The node wired into the output of the Passthrough node will be executed *after* the node wired into the waitFor input (e.g. important for some Revit operations). The value of the passThrough input will be passed on to the node wired into the output port of the Passthrough node.
list_create = List.Create(item0=passthrough)
flatten = List.Flatten(list=list_create)
collect_views = Custom[© Collect.Views]()  # package Crumple; Returns all views in a document. Excludes system views, templates, legends and schedule instances.
collector_of_placedviews = Custom[Collector of PlacedViews]()  # package Genius Loci; This node will collect all views placed on sheets in the active or given document.
watch = Watch(collector_of_placedviews.All_Placed_Views)
setDifference = List.SetDifference(list1=collect_views, list2=watch)
code_block_3 = CodeBlock { 12; }
getItemAtIndex_2 = List.GetItemAtIndex(list=setDifference, index=code_block_3)
list_create_2 = List.Create(item0=getItemAtIndex_2)
list_create_3 = List.Create(item0=list_create_2)
code_block_4 = CodeBlock { 0; }
byCoordinates = Point.ByCoordinates(x=code_block_4, y=code_block_4, z=code_block_4)
list_create_4 = List.Create(item0=byCoordinates)
list_create_5 = List.Create(item0=list_create_4)
code_block_5 = CodeBlock(Run=boolean, sheet=flatten, views=list_create_3, locations=list_create_5) { Run; sheet; views; locations; }  # frozen
sheet_placeviews_py = Python(IN[0]=code_block_5.Run, IN[1]=code_block_5.sheet, IN[2]=code_block_5.views, IN[3]=code_block_5.locations)
# ---------- sheet_placeviews_py.python (181 lines) ----------
################### Import References ###################
import clr

clr.AddReference("ProtoGeometry")
from Autodesk.DesignScript import Geometry as geom

clr.AddReference("RevitServices")
import RevitServices
from RevitServices.Persistence import DocumentManager
from RevitServices.Transactions import TransactionManager
doc =  DocumentManager.Instance.CurrentDBDocument
app = DocumentManager.Instance.CurrentUIApplication.Application

clr.AddReference("RevitNodes")
import Revit
clr.ImportExtensions(Revit.Elements)
clr.ImportExtensions(Revit.GeometryConversion)

clr.AddReference("RevitAPI")
from Autodesk.Revit.DB import *
from Autodesk.Revit.DB.Electrical import PanelScheduleSheetInstance as pssi

###### Definitions ######

# Ensure object is a list of objects.
def tolist(obj1):
	if hasattr(obj1,"__iter__"): return obj1
	else: return [obj1]

# Gets the Centre of the ScheduleSheetInstance
def GetScheduleCentre(v):		
	bBox = v.get_BoundingBox(doc.GetElement(v.OwnerViewId)).ToProtoType()
	return geom.Point.ByCoordinates((bBox.MinPoint.X+bBox.MaxPoint.X)/2,(bBox.MinPoint.Y+bBox.MaxPoint.Y)/2,0)

# Moves the Schedule post placement so that the centre is aligned to the placement point.
def MoveSchedule(v):	
	bBox = v.get_BoundingBox(doc.GetElement(v.OwnerViewId))
	w = (bBox.Max.X - bBox.Min.X)
	l = (bBox.Max.Y - bBox.Min.Y)		
	tVec = XYZ(-w/2,l/2,0)
	try:
		ElementTransformUtils.MoveElement(doc,v.Id,tVec)
		return True
	except:
		return False	

# Tries to get the Viewport of the given a View within the given Sheet to search in.
def FindViewportByView(sht,v):
	# Handle Schedules...
	# If View is schedule or panel schedule...
	if v.ViewType == ViewType.Schedule or v.ViewType == ViewType.PanelSchedule:
		# Get first ViewPort where View Ids match...
		return next((s for s in FilteredElementCollector(doc,sht.Id).OfClass(ScheduleSheetInstance).ToElements() if s.ScheduleId == v.Id),None)
	# Handle ViewPorts...
	vPorts = sht.GetAllViewports()
	if vPorts:
		# If there are Viewport, get the ViewPort Element from ViewPort Id...
		vPorts = [doc.GetElement(vp) for vp in vPorts]
		# Get first ViewPort where View Ids match...
		return next((vp for vp in vPorts if vp.ViewId == v.Id),None)		

# Correct position post ViewPort placement. When placing views on sheet, there is a slight dicrepancy (a known Revit API issue) where placement is not exactly at the coordinates we want.
def CorrectPlacement(sht,views,locs):	
	for v,loc in zip(views,locs):
		# Find the ViewPort on sheet by View...
		vp = FindViewportByView(sht,v)
		# If the ViewPort has been found...
		if vp:
			cPt = loc
			# Handle Schedules...
			if v.ViewType == ViewType.Schedule:
				cPt = GetScheduleCentre(vp)
			# Handle Panel Schedule...
			elif v.ViewType == ViewType.PanelSchedule:
				cPt = vp.Origin.ToPoint()
			# Handle everything else (Note: Additional handling may be required, further testing needed here)...
			else:
				cPt = vp.GetBoxCenter().ToPoint()
			# If distance is greater than some small value we should correct placement...
			if cPt.DistanceTo(loc) > 0.01:
				# For some reason, conversion ToXyx() doesn't concvert to internal unit type, so we apply scaling from mm to ft...
				d = geom.Vector.Scale(geom.Vector.ByTwoPoints(cPt,loc),0.00328084).ToXyz()
				# Move the Viewport...
				ElementTransformUtils.MoveElement(doc,vp.Id,d)
	
# Try add views to sheet given a sheet, a list of Views and a matching list of points.
def AddViewToSheet(sht,views,locs):
	arr = []		
	for v,l in zip(views, locs):
		# By default we will assume all views can be added to sheet until we test if they actually can be...
		canAddToSht = True;
		# Test if View can be added to sheet...
		if v.ViewType == ViewType.Schedule or v.ViewType == ViewType.PanelSchedule:
			# Schedules can be added more that one to a sheet, here we check if the Schedule is already on the sheet...
			canAddToSht = CanPlaceScheduleOnSheet(sht,v)
		else:
			# If the View is not a Schedule we can use the BuiltIn revit Method...
			canAddToSht = Viewport.CanAddViewToSheet(doc, sht.Id, v.Id)	
		# If we can add the view to the Sheet...
		if canAddToSht:			
			try:
				# If the view is a schedule...
				if v.ViewType == ViewType.Schedule:
					vp = ScheduleSheetInstance.Create(doc, sht.Id, v.Id, l.ToXyz())
					# Schedules are placed at top left corner, here we correct to centre placement...
					MoveSchedule(vp)						
					arr.append(vp)
				# If the View is a Panel Schedule...
				elif v.ViewType == ViewType.PanelSchedule:					
					vp = pssi.Create(doc, v.Id, sht)
					# Set the origin (centre) of the Panel Schedule...
					vp.Origin = l.ToXyz()						
					arr.append(vp)
				# If the View is something other...
				else:
					vp = Viewport.Create(doc, sht.Id, v.Id, l.ToXyz())					
					arr.append(vp)
			except Exception, e:
				arr.append(str(e))
		else:
			arr.append("Can't add this view to sheet either because the view is already on sheet or because there was an unknown error")
	return arr

# Test if the Schedule is already on sheet.
def CanPlaceScheduleOnSheet(sht,sch):
	# Get all schedules on sheet that are not the TitleblockRevisionSchedule Type...
	schedules = [s for s in FilteredElementCollector(doc,sht.Id).OfClass(ScheduleSheetInstance).ToElements() if not s.IsTitleblockRevisionSchedule]	
	# If the sheet has Schedules...
	if schedules:
		for s in schedules:
			# Is there a schedule on sheet that is the same as the one given...
			if s.ScheduleId.IntegerValue == sch.Id.IntegerValue:
				# Return false, that the schedule should not be placed on sheet...
				return False
	# Return true, the default case...
	return True

###### Inputs ######

run = tolist(IN[0])[0] # Should this node be run...
sheetsIN = tolist(UnwrapElement(IN[1])) # The Sheets to add the views to, this should be a flat list. So NO lists of lists...
viewsIN = tolist(UnwrapElement(IN[2])) # The Views to add to the sheet. This should be in the list structure [][]...
locsIN = tolist(IN[3]) # List of locations as DS Points. This should have the same list structure as the viewsIN, so [][]...

###### Outputs ######
outList = []
###### Script ######
if run:
	# check if list lengths are the same (the views and locations will be lists of lists here, but the outermost list layer should all be the same length)
	if len(sheetsIN) == len(viewsIN) == len(locsIN):
		# Open a Transaction to create ViewPorts...
		TransactionManager.Instance.EnsureInTransaction(doc)
		# loop through all lists (views and locs will be lists of lists)
		for sht,views,locs in zip(sheetsIN,viewsIN,locsIN):			
			# test if number of views and number of locations match
			if len(views) == len(locs):					
				outList.append(AddViewToSheet(sht,views,locs))								
			else:
				outList.append("Number of views does not match number of locations")		
		TransactionManager.Instance.TransactionTaskDone()
				
		# Here we will correct the dicrepancy between desired location and placed ViewPorts actual location...
		# Regenerate the document so we can get ViewPorts actual location...
		doc.Regenerate()
		
		# Open a new Transaction to make corrections...
		TransactionManager.Instance.EnsureInTransaction(doc)
		for sht,views,locs in zip(sheetsIN,viewsIN,locsIN):
			try:
				# Try correct placement discrepancy...
				CorrectPlacement(sht,views,locs)
			except Exception,ex:
				pass
		TransactionManager.Instance.TransactionTaskDone()
		
		# Return results to user...
		OUT = sheetsIN, outList
	else:
		OUT = "Number of sheets does not match either the number of view lists of location lists","Number of sheets does not match either the number of view lists of location lists"
else:
	OUT = "Set Run to True","Set Run to True"
# ----------------------------------------
code_block_6 = CodeBlock(a=sheet_placeviews_py) { results = a[1]; }
code_block_7 = CodeBlock(a=sheet_placeviews_py) { sheets = a[0]; }
all_categories_in_document = Custom[All categories in document]()  # package MEPover; Retrieves all categories from the current document and splits them up in Model, Annotation, Analytic and Internal Categories
placeViewsOnSheets = Custom[PlaceViewsOnSheets](Run=boolean, sheet=flatten, views=list_create_3, locations=list_create_5)  # package Cross-Tools
watch_2 = Watch(placeViewsOnSheets.sheet)
watch_3 = Watch(placeViewsOnSheets.viewport)
code_block_8 = CodeBlock(Run=boolean) { Run: bool; }
code_block_9 = CodeBlock(sheet=flatten) { sheet: var[]; }
code_block_10 = CodeBlock(views=list_create_3) { views: var[]..[]; }
code_block_11 = CodeBlock(locations=list_create_5) { locations: var[]..[]; }
code_block_12 = CodeBlock(Run=code_block_8, sheet=code_block_9, views=code_block_10, locations=code_block_11) { Run; sheet; views; locations; }
watch_4 = Watch(code_block_12.Run)
watch_5 = Watch(code_block_12.sheet)
watch_6 = Watch(code_block_12.views)
watch_7 = Watch(code_block_12.locations)
string_3 = StringInput("Place View(s) on a Sheet")
string_4 = StringInput("Next")
string_5 = StringInput("Customise your Sheet")
string_from_object = FromObject(obj=all_family_types_of_category)
code_block_13 = CodeBlock { 0; 13; }
remove = String.Remove(str=string_from_object, startIndex=code_block_13.out0, count=code_block_13.out1)
listview_data = Custom[Listview Data](Keys=remove, Values=all_family_types_of_category)  # package Data-Shapes; Create data for ListView input in UI.MultiInputForm ++ . Check out www.data-shapes.net for more infos.
string_6 = StringInput("Sheet Number")
textbox_data = Custom[TextBox Data](InputName=string_6, DefaultText=string_6)  # package Data-Shapes; Create Data for TextBox input in UI.MultipleInputForm ++ . Check out www.data-shapes.net for more informations
string_7 = StringInput("Sheet Name")
textbox_data_2 = Custom[TextBox Data](InputName=string_7, DefaultText=string_7)
list_create_6 = List.Create(item0=listview_data, item1=textbox_data, item2=textbox_data_2)
inputgroup_data = Custom[InputGroup Data](GroupTitle=string_5, Inputs=list_create_6)  # package Data-Shapes; Creates a group of inputs for UI.MultipleInputForm ++ . Check out www.data-shapes.net for more infos !
string_8 = StringInput("Select your View(s)")
listview_data_2 = Custom[Listview Data](Keys=setDifference, Values=setDifference)
inputgroup_data_2 = Custom[InputGroup Data](GroupTitle=string_8, Inputs=listview_data_2)
list_create_7 = List.Create(item0=inputgroup_data, item1=inputgroup_data_2)
boolean_2 = BoolSelector(true)
string_9 = StringInput("Cancel")
crossUI = Custom[CrossUI](Description=string_3, ButtonText=string_4, Inputs=list_create_7, Toggle=boolean_2, CancelButtonText=string_9)  # package Cross-Tools; This is a predefined UI based on Data-Shapes
