# Dynamo graph script.dyn "Manage Warnings" (Dynamo 2.6.1.8786)
# packages: Data-Shapes 2022.2.105, Clockwork for Dynamo 2.x 2.4.0, Bang! 2021.4.3, archi-lab.net 2023.213.1722, Crumple 2022.5.27

code_block = CodeBlock { "Select Categorie"; }
file_path = Filename("..\..\ShareFolder\icon.png")
code_block_2 = CodeBlock { "Next"; }
code_block_3 = CodeBlock { "Select Filter Color"; }
code_block_4 = CodeBlock { "Elements with Warning"; "Transparency"; "Elements without Warning"; }
colorinput_data = Custom[ColorInput Data](ButtonText=code_block_4.out0)  # package Data-Shapes; Create a color selection input for UI.MultiInputForm++ . Check out www.data-shapes.net for more infos! Warning : Only works with Revit 2017
code_block_5 = CodeBlock { 0; 100; 1; }
slider = Custom[Slider](InputName=code_block_4.out1, Minimum=code_block_5.out0, Maximum=code_block_5.out1, Default_Value=code_block_5.out0, Step=code_block_5.out2)  # package Data-Shapes; Creates slider input for UI.MultipleInputForm ++ . Set the step to decimal value if you want a double slider, or to a integer value if you want an integer slider.
colorinput_data_2 = Custom[ColorInput Data](ButtonText=code_block_4.out2)
slider_2 = Custom[Slider](InputName=code_block_4.out1, Minimum=code_block_5.out0, Maximum=code_block_5.out1, Default_Value=code_block_5.out0, Step=code_block_5.out2)
list_create = List.Create(item0=colorinput_data, item1=slider, item2=colorinput_data_2, item3=slider_2)
inputgroup_data = Custom[InputGroup Data](GroupTitle=code_block_3, Inputs=list_create)  # package Data-Shapes; Creates a group of inputs for UI.MultipleInputForm ++ . Check out www.data-shapes.net for more infos !
code_block_6 = CodeBlock { "Specific"; }
code_block_7 = CodeBlock { "Do you want to filter specific Warnings?"; }
boolean_input = Custom[Boolean input](InputName=code_block_7)  # package Data-Shapes; Creates a boolean input for UI.MultipleInputForm ++ . Check out www.data-shapes.net for more infos!
code_block_8 = CodeBlock { "Warning Message"; }
boolean = BoolSelector(true)
getWarnings = Bang.Revit.Elements.WarningTools.GetWarnings(toggle=boolean)
watch = Watch(getWarnings.Warning_Text)
uniqueItems = List.UniqueItems(list=watch)
listview_data = Custom[Listview Data](InputName=code_block_8, Keys=uniqueItems, Values=uniqueItems)  # package Data-Shapes; Create data for ListView input in UI.MultiInputForm ++ . Check out www.data-shapes.net for more infos.
list_create_2 = List.Create(item0=boolean_input, item1=listview_data)
inputgroup_data_2 = Custom[InputGroup Data](GroupTitle=code_block_6, Inputs=list_create_2)
list_create_3 = List.Create(item0=inputgroup_data, item1=inputgroup_data_2)
boolean_2 = BoolSelector(true)
code_block_9 = CodeBlock { "https://github.com/CrossArchitecture"; }
code_block_10 = CodeBlock { "Cancel"; }
multipleinputform = Custom[MultipleInputForm ++](Description_optional=code_block, Logo_optional=file_path, ButtonText_optional=code_block_2, Inputs=list_create_3, Toggle=boolean_2, LinkToHelp_optional=code_block_9, CancelButtonText_optional=code_block_10)  # package Data-Shapes; Create a form with multiple inputs. see www.data-shapes.net for tutorials and infos!
code_block_11 = CodeBlock { 5; }
chop = List.Chop(list=multipleinputform.User_Inputs, lengths=code_block_11)
code_block_12 = CodeBlock(x=chop) { x[0]; x[1]; }
code_block_13 = CodeBlock(x=code_block_12.out0) { x[0]; x[1]; x[2]; x[3]; x[4]; }
watch_2 = Watch(getWarnings.Failing_Elements)
watch_3 = Watch(watch_2)
flatten = List.Flatten(list=watch)
flatten_2 = List.Flatten(list=code_block_12.out1)
equals = List.Equals(objectA=flatten, objectB=flatten_2, lacing=Longest)
filterByBoolMask = List.FilterByBoolMask(list=watch_3, mask=equals)
flatten_3 = List.Flatten(list=filterByBoolMask.in)
id = Element.Id(element=flatten_3)
all_elements_in_active_view = ElementsInView()
id_2 = Element.Id(element=all_elements_in_active_view)
setIntersection = List.SetIntersection(list1=id, list2=id_2)
elements_with_filtered_warnings = archilab.Revit.Selection.Select.ByElementId(id=setIntersection)  # "Elements with filtered Warnings in activ View"
setDifference = List.SetDifference(list1=id, list2=id_2)
elements_without_filtered = archilab.Revit.Selection.Select.ByElementId(id=setDifference)  # "Elements without filtered Warnings in activ View"
list_create_4 = List.Create(item0=elements_with_filtered_warnings, item1=elements_without_filtered)
flatten_4 = List.Flatten(list=watch_3)
id_3 = Element.Id(element=flatten_4)
setIntersection_2 = List.SetIntersection(list1=id_3, list2=id_2)
elements_with_warnings_in_activ = archilab.Revit.Selection.Select.ByElementId(id=setIntersection_2)  # "Elements with Warnings in activ View"
setDifference_2 = List.SetDifference(list1=id_2, list2=setIntersection_2)
elements_without_warnings_in = archilab.Revit.Selection.Select.ByElementId(id=setDifference_2)  # "Elements without Warnings in activ View"
list_create_5 = List.Create(item0=elements_with_warnings_in_activ, item1=elements_without_warnings_in)
flow_ifthenelse = Custom[© Flow.IfThenElse](If=code_block_13.out4, Then=list_create_4, Else=list_create_5)  # package Crumple; A simple if/then/else logic gate. If true, you get the 'then' input, otherwise you get the 'else' input. Unlike the OOTB 'If' node, this one allows differing list sizes.
code_block_14 = CodeBlock(x=flow_ifthenelse) { x[0]; x[1]; }
toDynamoColor = Custom[Color.ToDynamoColor](RevitColor=code_block_13.out0)  # package Clockwork for Dynamo 2.x; Converts Revit colors into Dynamo colors
components = Color.Components(c=toDynamoColor)
byARGB = Color.ByARGB(r=components.r, g=components.g, b=components.b)
fill_patterns = FillPatterns("<Solid fill>")
byProperties = Revit.Filter.OverrideGraphicSettings.ByProperties(projectionFillColor=byARGB, projectionFillPattern=fill_patterns, transparency=code_block_13.out1)
toDynamoColor_2 = Custom[Color.ToDynamoColor](RevitColor=code_block_13.out2)
components_2 = Color.Components(c=toDynamoColor_2)
byARGB_2 = Color.ByARGB(r=components_2.r, g=components_2.g, b=components_2.b)
byProperties_2 = Revit.Filter.OverrideGraphicSettings.ByProperties(projectionFillColor=byARGB_2, projectionFillPattern=fill_patterns, transparency=code_block_13.out3)
list_create_6 = List.Create(item0=byProperties, item1=byProperties_2)
code_block_15 = CodeBlock(x=list_create_6) { x[0]; x[1]; }
overrideInView = Element.OverrideInView(element=code_block_14.out0, overrides=code_block_15.out0)
overrideInView_2 = Element.OverrideInView(element=code_block_14.out1, overrides=code_block_15.out1)
