# Dynamo graph script.dyn (Dynamo 2.6.1.8786)
# packages: Data-Shapes 2022.2.105, Genius Loci 2023.2.21, Cross-Tools 0.0.1, Clockwork for Dynamo 1.x 1.31.1

get_shared_parameter = Custom[Get Shared Parameter]()  # package Genius Loci; Get the parameters names, parameters groups, parameters types and assigned categories of the active shared parameter file.
flatten = List.Flatten(list=get_shared_parameter.ParameterName)
uniqueItems = List.UniqueItems(list=flatten)
watch = Watch(uniqueItems)

# group: To Revit
code_block = CodeBlock { 5; 1; 2; 3; 4; 5; }  # frozen
takeEveryNthItem = List.TakeEveryNthItem(n=code_block.out0, offset=code_block.out1)  # unwired: list
string = StringInput(", ")
split = String.Split(str=takeEveryNthItem, separator0=string)
parameter_name = List.Flatten(list=split)
takeEveryNthItem_2 = List.TakeEveryNthItem(n=code_block.out0, offset=code_block.out2)  # unwired: list
category = List.Flatten(list=takeEveryNthItem_2)
takeEveryNthItem_3 = List.TakeEveryNthItem(n=code_block.out0, offset=code_block.out3)  # unwired: list
parameter_typ = List.Flatten(list=takeEveryNthItem_3)
takeEveryNthItem_4 = List.TakeEveryNthItem(n=code_block.out0, offset=code_block.out4)  # unwired: list
parameter_group = List.Flatten(list=takeEveryNthItem_4)
takeEveryNthItem_5 = List.TakeEveryNthItem(n=code_block.out0, offset=code_block.out5)  # unwired: list
instance = List.Flatten(list=takeEveryNthItem_5)

code_block_2 = CodeBlock { "Generate Parameter"; }
file_path = Filename("..\..\ShareFolder\icon.png")
code_block_3 = CodeBlock { "Next"; "Cancel"; }
code_block_4 = CodeBlock { "Parameter Group(s)"; }
watch_2 = Watch(get_shared_parameter.Unique_GroupName)
listview_data = Custom[Listview Data](InputName=code_block_4, Keys=watch_2, Values=watch_2)  # package Data-Shapes; Create data for ListView input in UI.MultiInputForm ++ . Check out www.data-shapes.net for more infos.

# group: Activate
boolean = BoolSelector(true)
boolean_2 = BoolSelector(true)

code_block_5 = CodeBlock { "https://github.com/CrossArchitecture"; }
code_block_6 = CodeBlock { 600; }
multipleinputform = Custom[MultipleInputForm ++](Description_optional=code_block_2, Logo_optional=file_path, ButtonText_optional=code_block_3.out0, Inputs=listview_data, Toggle=boolean, LinkToHelp_optional=code_block_5, CancelButtonText_optional=code_block_3.out1, Width_optional=code_block_6)  # package Data-Shapes; Create a form with multiple inputs. see www.data-shapes.net for tutorials and infos!
flatten_2 = List.Flatten(list=multipleinputform.User_Inputs)
code_block_7 = CodeBlock { "Enter your parameters in the respective group!"; }
file_path_2 = Filename("..\..\ShareFolder\icon.png")
code_block_8 = CodeBlock { "Next"; "Cancel"; }
textnote_data = Custom[TextNote Data](TextNote=flatten_2)  # package Data-Shapes; Create Data for TextNote input in UI.MultipleInputForm ++ . Check out www.data-shapes.net for more informations
flatten_3 = List.Flatten(list=textnote_data)
code_block_9 = CodeBlock { "Parameter Name"; "Category"; "Parameter Grouping"; "Parameter Type"; "Parameter Instance?"; }
textbox_data = Custom[TextBox Data](InputName=code_block_9.out0)  # package Data-Shapes; Create Data for TextBox input in UI.MultipleInputForm ++ . Check out www.data-shapes.net for more informations
count = List.Count(list=flatten_2)
ofRepeatedItem = List.OfRepeatedItem(item=textbox_data, amount=count)
flatten_4 = List.Flatten(list=get_shared_parameter.Categories)
uniqueItems_2 = List.UniqueItems(list=flatten_4)
watch_3 = Watch(uniqueItems_2)
dropdown_data = Custom[DropDown Data](InputName=code_block_9.out1, Keys=watch_3, Values=watch_3)  # package Data-Shapes; Create data for DropDown input in UI.MultiInputForm ++ . Check out www.data-shapes.net for more infos.
ofRepeatedItem_2 = List.OfRepeatedItem(item=dropdown_data, amount=count)
flatten_5 = List.Flatten(list=get_shared_parameter.ParameterType)
uniqueItems_3 = List.UniqueItems(list=flatten_5)
watch_4 = Watch(uniqueItems_3)
dropdown_data_2 = Custom[DropDown Data](InputName=code_block_9.out2, Keys=watch_4, Values=watch_4)
ofRepeatedItem_3 = List.OfRepeatedItem(item=dropdown_data_2, amount=count)
flatten_6 = List.Flatten(list=get_shared_parameter.ParameterGroup)
uniqueItems_4 = List.UniqueItems(list=flatten_6)
watch_5 = Watch(uniqueItems_4)
dropdown_data_3 = Custom[DropDown Data](InputName=code_block_9.out3, Keys=watch_5, Values=watch_5)
ofRepeatedItem_4 = List.OfRepeatedItem(item=dropdown_data_3, amount=count)
boolean_input = Custom[Boolean input](InputName=code_block_9.out4)  # package Data-Shapes; Creates a boolean input for UI.MultipleInputForm ++ . Check out www.data-shapes.net for more infos!
ofRepeatedItem_5 = List.OfRepeatedItem(item=boolean_input, amount=count)
zip_funktion_multiple = Python(IN[0]=flatten_3, IN[1]=ofRepeatedItem, IN[2]=ofRepeatedItem_2, IN[3]=ofRepeatedItem_3, IN[4]=ofRepeatedItem_4, IN[5]=ofRepeatedItem_5)
# ---------- zip_funktion_multiple.python (34 lines) ----------
# Load the Python Standard and DesignScript Libraries
import sys
import clr
clr.AddReference('ProtoGeometry')
from Autodesk.DesignScript.Geometry import *

# The inputs to this node will be stored as a list in the IN variables.
dataEnteringNode = IN

# Extrahiere die Eingangslisten L1 und L2
L1 = IN[0]
L2 = IN[1]
L3 = IN[2]
L4 = IN[3]
L5 = IN[4]
L6 = IN[5]

# Erstelle eine leere Liste für die neue Liste
nL = []

# Verwende eine For Each-Schleife, um die Elemente paarweise zu kombinieren
for i, (elem1, elem2, elem3, elem4, elem5, elem6) in enumerate(zip(L1, L2, L3, L4, L5, L6)):
    # Füge die kombinierten Elemente zur neuen Liste hinzu
    nL.append(elem1)
    nL.append(elem2)
    nL.append(elem3)
    nL.append(elem4)
    nL.append(elem5)
    nL.append(elem6)

# Das Ergebnis ist die neue Liste nL

# Weise den Wert der Ausgabevariablen OUT zu
OUT = nL
# ----------------------------------------
inputgroup_data = Custom[InputGroup Data](Inputs=zip_funktion_multiple)  # package Data-Shapes; Creates a group of inputs for UI.MultipleInputForm ++ . Check out www.data-shapes.net for more infos !
code_block_10 = CodeBlock { "https://github.com/CrossArchitecture"; }
code_block_11 = CodeBlock { 600; }
multipleinputform_2 = Custom[MultipleInputForm ++](Description_optional=code_block_7, Logo_optional=file_path_2, ButtonText_optional=code_block_8.out0, Inputs=inputgroup_data, Toggle=boolean_2, LinkToHelp_optional=code_block_10, CancelButtonText_optional=code_block_8.out1, Width_optional=code_block_11)
code_block_12 = CodeBlock { 5; }
chop = List.Chop(list=multipleinputform_2.User_Inputs, lengths=code_block_12)
transpose = List.Transpose(lists=chop)
addItemToFront = List.AddItemToFront(item=flatten_2, list=transpose)
watch_6 = Watch(addItemToFront)
code_block_13 = CodeBlock(x=watch_6) { x[1]; x[0]; x[3]; x[4]; x[5]; x[2]; }
string_from_object = FromObject(obj=code_block_13.out2)
string_from_object_2 = FromObject(obj=code_block_13.out3)
string_from_object_3 = FromObject(obj=code_block_13.out5)
byName = Category.ByName(name=string_from_object_3)
createProjectParameter = Parameter.CreateProjectParameter(parameterName=code_block_13.out0, groupName=code_block_13.out1, type=string_from_object, group=string_from_object_2, instance=code_block_13.out4, categoryList=byName, lacing=Shortest)

# group: Shared Parameter Option
code_block_14 = CodeBlock { "Choose Shared Parameter file!"; }
code_block_15 = CodeBlock { "Next"; "Cancel"; }
string_2 = StringInput("L:\projekte\254_HDW Bo\02_Planung\__RVT\03 Parameters\Shared Parameters\")
string_3 = StringInput("Shared Parameters file")
filepath_data = Custom[FilePath Data](DefaulPath=string_2, ButtonText=string_3)  # package Data-Shapes; Create filepath input for UI.MultipleInputForm ++ . Check out www.data-shapes.net for more infos !
boolean_3 = BoolSelector(false)
crossUI = Custom[CrossUI](Description=code_block_14, ButtonText=code_block_15.out0, Inputs=filepath_data, Toggle=boolean_3, CancelButtonText=code_block_15.out1)  # frozen; package Cross-Tools; This is a predefined UI based on Data-Shapes

passthrough = Custom[Passthrough](passThrough=inputgroup_data, waitFor=multipleinputform.Was_Run)  # package Clockwork for Dynamo 1.x; Forces a sequential order of execution. The node wired into the output of the Passthrough node will be executed *after* the node wired into the waitFor input (e.g. important for some Revit operations). The value of the passThrough input will be passed on to the node wired into the output port of the Passthrough node.
