# Dynamo graph script.dyn (Dynamo 2.6.1.8786)
# packages: DynamoMEP 1.0.3, Clockwork for Dynamo 2.x 2.3.0, QuasarII 2021.25.101, archi-lab.net 2022.212.2722, archi-lab.net 2023.213.1722, Clockwork for Dynamo 2.x 2.6.0, Data-Shapes 2022.2.105

rooms_by_status = RoomsByStatus()
code_block = CodeBlock { 10; }
takeItems = List.TakeItems(list=rooms_by_status.PlacedRooms, amount=code_block)
watch = Watch(takeItems)

# group: Output-Parameter
code_block_2 = CodeBlock { "CXS Lichte_Raumhoehe_min"; }
code_block_3 = CodeBlock { "CXS Lichte_Raumhoehe_max"; }

location = Custom[Element.Location+](element=watch)  # package Clockwork for Dynamo 2.x; Returns the location of an element as point, curve or curve loop, along with some booleans to help filtering the results. Unlike the OOTB Element.GetLocation node, it also returns sketch lines of sketch-based elements like floor slabs as well as the element's rotation property. Additionally, it supports quite a few more element types (e.g. railings, stairs etc.).

# group: Choose Setup View, clean up View before execution - Finish Room Height
views = Views("Finish Room Height")  # graph input

# group: Collect Rooms, create grid, translate and raybounce
ZAxis = Vector.ZAxis()
code_block_4 = CodeBlock { 0.5; 1; }
translate = Geometry.Translate(geometry=location.points, direction=ZAxis, distance=code_block_4.out0)
ZAxis_2 = Vector.ZAxis()
reverse = Vector.Reverse(vector=ZAxis_2)
code_block_5 = CodeBlock { 1; }
byOriginDirection = Revit.References.RayBounce.ByOriginDirection(origin=translate, direction=reverse, maxBounces=code_block_5, view=views)
code_block_6 = CodeBlock { 1; }
grid = DynamoMEP.Room.Grid(room=watch, step=code_block_6)
distanceTo = Geometry.DistanceTo(geometry=translate, other=byOriginDirection.points)
lastItem = List.LastItem(list=distanceTo@@L2)
ZAxis_3 = Vector.ZAxis()
code_block_7 = CodeBlock { 1; }
collectRoomsByStatus = QuasarII.RoomUtility.CollectRoomsByStatus()  # frozen
select_model_element = DSModelElementSelection()  # 1 picked in the model; frozen

lastItem_2 = List.LastItem(list=byOriginDirection.points@@L2)
list_create = List.Create(item0=grid)
sub = lastItem - code_block_4.out1

# group (continued): Collect Rooms, create grid, translate and raybounce
translate_2 = Geometry.Translate(geometry=list_create, direction=reverse, distance=sub)

# group: Create Placeholder Mass
finishBoundary = Room.FinishBoundary(room=watch)

firstItem = List.FirstItem(list=finishBoundary@L3)

# group (continued): Create Placeholder Mass
byJoinedCurves = PolyCurve.ByJoinedCurves(curves=firstItem)
translate_3 = Geometry.Translate(geometry=byJoinedCurves, direction=reverse, distance=sub)
patch = Curve.Patch(curve=translate_3)
byGeometries = ImportInstance.ByGeometries(geometries=patch)

passthrough = Custom[Passthrough](passThrough=translate_2, waitFor=byGeometries)  # package Clockwork for Dynamo 2.x; Forces a sequential order of execution. The node wired into the output of the Passthrough node will be executed *after* the node wired into the waitFor input (e.g. important for some Revit operations). The value of the passThrough input will be passed on to the node wired into the output port of the Passthrough node.

# group (continued): Collect Rooms, create grid, translate and raybounce
byOriginDirection_2 = Revit.References.RayBounce.ByOriginDirection(origin=passthrough, direction=ZAxis_3, maxBounces=code_block_7, view=views)

# group: quick math
flatten = List.Flatten()  # unwired: list
map = List.Map(list=byOriginDirection_2.points, f_x=flatten)
code_block_8 = CodeBlock(a=map, b=lastItem_2) { a; b; a.Z == b.Z + 0.5; }
filterByBoolMask = List.FilterByBoolMask(list=map, mask=code_block_8.out2)
code_block_9 = CodeBlock(b=lastItem_2, a=filterByBoolMask.out) { b; a; a.Z - b.Z; }
sort = List.Sort()  # unwired: list
map_2 = List.Map(list=code_block_9.out2, f_x=sort)
code_block_10 = CodeBlock { 1; }
le = map_2 <= code_block_10
filterByBoolMask_2 = List.FilterByBoolMask(list=map_2, mask=le)
firstItem_2 = List.FirstItem()  # unwired: list
map_3 = List.Map(list=filterByBoolMask_2.out, f_x=firstItem_2)
code_block_11 = CodeBlock(a=filterByBoolMask.out) { a; }
lastItem_3 = List.LastItem()  # unwired: list
map_4 = List.Map(list=filterByBoolMask_2.out, f_x=lastItem_3)

code_block_12 = CodeBlock { 0; }
replaceNull = Custom[List.ReplaceNull](seq=map_3, replacement=code_block_12)  # package Clockwork for Dynamo 2.x; Replaces all null values within a given list with a substitute

# group (continued): quick math
setParameterByName = Element.SetParameterByName(element=watch, parameterName=code_block_2, value=replaceNull)

watch_2 = Watch(byOriginDirection_2.elements)

# group: Get Ceiling Finish and Write to correspondending room - WORK IN PROGRESS
code_block_13 = CodeBlock { "CXS CeilingFinish"; }
code_block_14 = CodeBlock { " | "; }
join = List.Join()  # unwired: list0, list1, list2
flatten_2 = List.Flatten(list=watch_2@L3)  # frozen
code_block_15 = CodeBlock { "Category"; "Ceilings"; "Floors"; "CXS RoomFinish"; "Roofs"; }
getParameterValueByName = Element.GetParameterValueByName(element=flatten_2, parameterName=code_block_15.out0)
string_from_object = FromObject(obj=getParameterValueByName)
eq = string_from_object == code_block_15.out1
filterByBoolMask_3 = List.FilterByBoolMask(list=flatten_2, mask=eq)
getParameterValueByName_2 = Element.GetParameterValueByName(element=flatten_2, parameterName=code_block_15.out0)
string_from_object_2 = FromObject(obj=getParameterValueByName_2)
eq_2 = string_from_object_2 == code_block_15.out2
filterByBoolMask_4 = List.FilterByBoolMask(list=flatten_2, mask=eq_2)
getParameterValueByName_3 = Element.GetParameterValueByName(element=flatten_2, parameterName=code_block_15.out0)
string_from_object_3 = FromObject(obj=getParameterValueByName_3)
eq_3 = string_from_object_3 == code_block_15.out4
filterByBoolMask_5 = List.FilterByBoolMask(list=flatten_2, mask=eq_3)
combine = List.Combine(comb=join, list1=filterByBoolMask_3.in, list2=filterByBoolMask_4.in, list3=filterByBoolMask_5.in)
getParameterValueByName_4 = Element.GetParameterValueByName(element=combine, parameterName=code_block_15.out3)
string_from_object_4 = FromObject(obj=getParameterValueByName_4)
uniqueItems = List.UniqueItems(list=string_from_object_4@L2)
clean = archilab.Lists.Lists.Clean(list=uniqueItems)
uniqueItems_2 = List.UniqueItems(list=clean@L2)
join_2 = String.Join(separator=code_block_14, string0=uniqueItems_2)
setParameterByName_2 = Element.SetParameterByName(element=watch@L1, parameterName=code_block_13, value=join_2@L1)

replaceNull_2 = Custom[List.ReplaceNull](seq=map_4, replacement=code_block_12)

# group (continued): quick math
setParameterByName_3 = Element.SetParameterByName(element=watch, parameterName=code_block_3, value=replaceNull_2)

end = Revit.Transaction.Transaction.End(input=setParameterByName_3)
passthrough_2 = Custom[Passthrough](passThrough=byGeometries, waitFor=end)
delete = Element.Delete(element=passthrough_2)

# group: Filter Elements by Room-Name
code_block_16 = CodeBlock { "Name"; }
getParameterValueByName_5 = Element.GetParameterValueByName(element=watch, parameterName=code_block_16)  # frozen
code_block_17 = CodeBlock { ["Schacht","Luftraum","Aufz","Ansaugturm","Schächte"]; }
contains = String.Contains(str=getParameterValueByName_5, searchFor=code_block_17, lacing=CrossProduct)
anyTrue = Custom[Booleans.AnyTrue]()  # package Clockwork for Dynamo 2.x; Returns true if any item in a list of booleans is true. ATTENTION: This node will be deprecated in 2024. As of Revit 2022, please switch to the OOTB node AnyTrue.; unwired: seq
map_5 = List.Map(list=contains, f_x=anyTrue)
filterByBoolMask_6 = List.FilterByBoolMask(list=watch, mask=map_5)

watch_3 = Watch(grid)
categories = Categories("OST_Rooms")
views_2 = Views()  # nothing selected; graph input
all_elements_of_category_in_view = ElementsOfCategoryInView(Category=categories, View=views_2)  # frozen
categories_2 = Categories("OST_Rooms")
views_3 = Views("EG_OKFB_M1/100 Overview")  # graph input
all_elements_of_category_in_view_2 = ElementsOfCategoryInView(Category=categories_2, View=views_3)  # frozen
watch_4 = Watch(all_elements_of_category_in_view_2)
location_2 = Custom[Element.Location+](element=watch_4)

# group: Choose Setup View, clean up View before execution - Raw Room height
views_4 = Views("Raw Room Height")  # graph input

# group: Collect Rooms, create grid, translate and raybounce
code_block_18 = CodeBlock { 1; }
ZAxis_4 = Vector.ZAxis()
reverse_2 = Vector.Reverse(vector=ZAxis_4)
ZAxis_5 = Vector.ZAxis()
code_block_19 = CodeBlock { 0.01; 0.02; }
translate_4 = Geometry.Translate(geometry=location_2.points, direction=ZAxis_5, distance=code_block_19.out0)
code_block_20 = CodeBlock { 1; }
byOriginDirection_3 = Revit.References.RayBounce.ByOriginDirection(origin=translate_4, direction=reverse_2, maxBounces=code_block_20, view=views_4)
distanceTo_2 = Geometry.DistanceTo(geometry=translate_4, other=byOriginDirection_3.points)
lastItem_4 = List.LastItem(list=distanceTo_2@@L2)
ZAxis_6 = Vector.ZAxis()
code_block_21 = CodeBlock { 1; }
select_model_element_2 = DSModelElementSelection()  # 1 picked in the model; frozen

grid_2 = DynamoMEP.Room.Grid(room=watch_4, step=code_block_18)
list_create_2 = List.Create(item0=grid_2)
sub_2 = lastItem_4 - code_block_19.out1

# group (continued): Collect Rooms, create grid, translate and raybounce
translate_5 = Geometry.Translate(geometry=list_create_2, direction=reverse_2, distance=sub_2)
byOriginDirection_4 = Revit.References.RayBounce.ByOriginDirection(origin=translate_5, direction=ZAxis_6, maxBounces=code_block_21, view=views_4)

watch_5 = Watch(byOriginDirection_4.elements)

# group: Get Ceiling Finish and Write to correspondending room - WORK IN PROGRESS
code_block_22 = CodeBlock { "CXS CeilingFinish"; }
code_block_23 = CodeBlock { " | "; }
join_3 = List.Join()  # unwired: list0, list1, list2
flatten_3 = List.Flatten(list=watch_5@L3)  # frozen
code_block_24 = CodeBlock { "Category"; "Ceilings"; "Floors"; "CXS RoomFinish"; "Roofs"; }
getParameterValueByName_6 = Element.GetParameterValueByName(element=flatten_3, parameterName=code_block_24.out0)
string_from_object_5 = FromObject(obj=getParameterValueByName_6)
eq_4 = string_from_object_5 == code_block_24.out1
filterByBoolMask_7 = List.FilterByBoolMask(list=flatten_3, mask=eq_4)
getParameterValueByName_7 = Element.GetParameterValueByName(element=flatten_3, parameterName=code_block_24.out0)
string_from_object_6 = FromObject(obj=getParameterValueByName_7)
eq_5 = string_from_object_6 == code_block_24.out2
filterByBoolMask_8 = List.FilterByBoolMask(list=flatten_3, mask=eq_5)
getParameterValueByName_8 = Element.GetParameterValueByName(element=flatten_3, parameterName=code_block_24.out0)
string_from_object_7 = FromObject(obj=getParameterValueByName_8)
eq_6 = string_from_object_7 == code_block_24.out4
filterByBoolMask_9 = List.FilterByBoolMask(list=flatten_3, mask=eq_6)
combine_2 = List.Combine(comb=join_3, list1=filterByBoolMask_7.in, list2=filterByBoolMask_8.in, list3=filterByBoolMask_9.in)
getParameterValueByName_9 = Element.GetParameterValueByName(element=combine_2, parameterName=code_block_24.out3)
string_from_object_8 = FromObject(obj=getParameterValueByName_9)
uniqueItems_3 = List.UniqueItems(list=string_from_object_8@L2)
clean_2 = archilab.Lists.Lists.Clean(list=uniqueItems_3)
uniqueItems_4 = List.UniqueItems(list=clean_2@L2)
join_4 = String.Join(separator=code_block_23, string0=uniqueItems_4)
setParameterByName_4 = Element.SetParameterByName(element=watch_4@L1, parameterName=code_block_22, value=join_4@L1)

# group: Output-Parameter
code_block_25 = CodeBlock { "CXS Roh_Raumhoehe_min"; }
code_block_26 = CodeBlock { "CXS Roh_Raumhoehe_max"; }

lastItem_5 = List.LastItem(list=byOriginDirection_3.points@@L2)

# group: quick math
flatten_4 = List.Flatten()  # unwired: list
map_6 = List.Map(list=byOriginDirection_4.points, f_x=flatten_4)
code_block_27 = CodeBlock(a=map_6, b=lastItem_5) { a; b; a.Z == b.Z + 0.01; }
filterByBoolMask_10 = List.FilterByBoolMask(list=map_6, mask=code_block_27.out2)
code_block_28 = CodeBlock(b=lastItem_5, a=filterByBoolMask_10.out) { b; a; a.Z - b.Z; }
sort_2 = List.Sort()  # unwired: list
map_7 = List.Map(list=code_block_28.out2, f_x=sort_2)
code_block_29 = CodeBlock { 1; }
le_2 = map_7 <= code_block_29
filterByBoolMask_11 = List.FilterByBoolMask(list=map_7, mask=le_2)
firstItem_3 = List.FirstItem()  # unwired: list
map_8 = List.Map(list=filterByBoolMask_11.out, f_x=firstItem_3)
code_block_30 = CodeBlock(a=filterByBoolMask_10.out) { a; }
lastItem_6 = List.LastItem()  # unwired: list
map_9 = List.Map(list=filterByBoolMask_11.out, f_x=lastItem_6)

code_block_31 = CodeBlock { 0; }
replaceNull_3 = Custom[List.ReplaceNull](seq=map_8, replacement=code_block_31)

# group (continued): quick math
setParameterByName_5 = Element.SetParameterByName(element=watch_4, parameterName=code_block_25, value=replaceNull_3)

code_block_32 = CodeBlock { 10; }
takeItems_2 = List.TakeItems(list=all_elements_of_category_in_view_2, amount=code_block_32)

# group: Create Placeholder Mass
finishBoundary_2 = Room.FinishBoundary(room=watch_4)

firstItem_4 = List.FirstItem(list=finishBoundary_2@L3)

# group (continued): Create Placeholder Mass
byJoinedCurves_2 = PolyCurve.ByJoinedCurves(curves=firstItem_4)
translate_6 = Geometry.Translate(geometry=byJoinedCurves_2, direction=reverse_2, distance=sub_2)
patch_2 = Curve.Patch(curve=translate_6)
byGeometries_2 = ImportInstance.ByGeometries(geometries=patch_2)

replaceNull_4 = Custom[List.ReplaceNull](seq=map_9, replacement=code_block_31)

# group (continued): quick math
setParameterByName_6 = Element.SetParameterByName(element=watch_4, parameterName=code_block_26, value=replaceNull_4)

end_2 = Revit.Transaction.Transaction.End(input=setParameterByName_6)
passthrough_3 = Custom[Passthrough](passThrough=byGeometries_2, waitFor=end_2)
delete_2 = Element.Delete(element=passthrough_3)

# group: Filter Elements by Room-Name
code_block_33 = CodeBlock { "Name"; }
getParameterValueByName_10 = Element.GetParameterValueByName(element=watch_4, parameterName=code_block_33)  # frozen
code_block_34 = CodeBlock { ["Schacht","Luftraum","Aufz","Ansaugturm","Schächte"]; }
contains_2 = String.Contains(str=getParameterValueByName_10, searchFor=code_block_34, lacing=CrossProduct)
anyTrue_2 = Custom[Booleans.AnyTrue]()  # unwired: seq
map_10 = List.Map(list=contains_2, f_x=anyTrue_2)
filterByBoolMask_12 = List.FilterByBoolMask(list=watch_4, mask=map_10)

watch_6 = Watch(grid_2)
collectRoomsByStatus_2 = QuasarII.RoomUtility.CollectRoomsByStatus()  # frozen
code_block_35 = CodeBlock { "CXS Lichte_Raumhoehe_avg"; }
code_block_36 = CodeBlock { "Generate Parameter"; }
file_path = Filename("..\..\ShareFolder\icon.png")
code_block_37 = CodeBlock { "Next"; "Cancel"; }
boolean = BoolSelector(true)
code_block_38 = CodeBlock { "https://github.com/CrossArchitecture"; }
code_block_39 = CodeBlock { 600; }
multipleinputform = Custom[MultipleInputForm ++](Description_optional=code_block_36, Logo_optional=file_path, ButtonText_optional=code_block_37.out0, Toggle=boolean, LinkToHelp_optional=code_block_38, CancelButtonText_optional=code_block_37.out1, Width_optional=code_block_39)  # package Data-Shapes; Create a form with multiple inputs. see www.data-shapes.net for tutorials and infos!; unwired: Inputs
