# Dynamo custom node CrossUI.dyf (Dynamo 2.6.1.8786)
# category: Cross-Tools
# This is a predefined UI based on Data-Shapes
# packages: Data-Shapes 2022.2.105

Description = Input(Description: string = "")
file_path = Filename("..\..\ShareFolder\icon.png")
ButtonText = Input(ButtonText: string = "Set Values")
Inputs = Input(Inputs: var[])
Toggle = Input(Toggle: bool = false)
code_block = CodeBlock { "https://github.com/CrossArchitecture"; }
CancelButtonText = Input(CancelButtonText: string = null)
MaxHeight = Input(MaxHeight: int = 0)
Width = Input(Width: int = 400)
LabelWidth = Input(LabelWidth: int = 140)
multipleinputform = Custom[MultipleInputForm ++](Description_optional=Description, Logo_optional=file_path, ButtonText_optional=ButtonText, Inputs=Inputs, Toggle=Toggle, LinkToHelp_optional=code_block, CancelButtonText_optional=CancelButtonText, MaxHeight_optional=MaxHeight, Width_optional=Width, LabelWidth_optional=LabelWidth)  # package Data-Shapes; Create a form with multiple inputs. see www.data-shapes.net for tutorials and infos!
User_Inputs = Output(multipleinputform.User_Inputs)
Was_Run = Output(multipleinputform.Was_Run)
Was_Cancelled = Output(multipleinputform.Was_Cancelled)
