# Dynamo custom node RunStepwise.dyf (Dynamo 2.6.1.8786)
# category: Cross-Tools
# Runs your Dynamo Script stepwise with User Interaction.

NameStep = Input(NameStep: var[]..[])
Data = Input(Data: var[]..[])
run_stepwise = Python(IN[0]=NameStep, IN[1]=Data)
# ---------- run_stepwise.python (54 lines) ----------
import clr
# import windows form 

clr.AddReference("System.Windows.Forms")
#import system drawing 
clr.AddReference("System.Drawing")
# import system
import System
from System.Windows.Forms import *
from System.Drawing import *

NameStep = IN[0]
data = IN[1]

class CreateWindow(Form):
	def __init__(self):
		
		
		self.Name = "Form1"
		self.Text = "Continue"
		self.Size = Size(500,200)
		self.CenterToScreen()
		self.AutoScroll = True
		
		v = Label()
		v.Text = str(NameStep)
		v.Location = Point(200,70)
		v.Parent = self
	
		self.values = []
		
		
			
		button = Button()
		button.Parent = self
		button.Text = "Next step"
		button.Location = Point(400,100)		
		
		button.Click += self.ButtonClicked
	
	def ButtonClicked(self, sender, args):
		if sender.Click:
			self.Close()
			
			form2.ShowDialog()
			

				
			
			
			
form = CreateWindow()
Application.Run(form)
OUT = data
# ----------------------------------------
OUT = Output(run_stepwise)
